# Grasshopper definition cat-stand-v3 (1).gh (Grasshopper 1.0.7)
# plug-ins: Pufferfish

# notes: Draw 2 cat surfaces as support plates
cat_surfaces = Surface([<surface referenced from the Rhino model> x2])
# notes: Control for/backward positioning of the back plate (Y position)
number_slider = Slider(30, range=0..100)
# notes: Adjust the distance between the two cat supports symetrically
number_slider_2 = Slider(25, range=0..30)
# notes: Calculate the centroid of the two cat supports
area = Area(Geometry=cat_surfaces)  # -> Area, Centroid
# notes: Adjust the phone model dimensions
phone_width_mm = Slider(81, range=0..300)
phone_length_mm = Slider(165, range=0..300)
back_width_tolerance = Slider(15, range=0..100)
back_length_tolerance = Slider(30, range=0..100)
deconstruct = Deconstruct(Point=area.Centroid)  # -> XComponent, YComponent, ZComponent
construct_point = ConstructPoint(XCoordinate=0, YCoordinate=number_slider, ZCoordinate="0")
negative = Negative(Value=number_slider_2)
addition = Addition(A=back_length_tolerance, B=phone_length_mm)
# notes: Add to the back plate length and width if necessary
addition_2 = Addition(A=back_width_tolerance, B=phone_width_mm)
back_plate_angle = Slider(70, range=0..90)
# notes: Adjust the back plate viewing angle
xy_plane = XYPlane(Origin=construct_point)
yz_plane = YZPlane(Origin=construct_point)
construct_point_2 = ConstructPoint(XCoordinate=[number_slider_2, negative], YCoordinate=deconstruct.YComponent, ZCoordinate=deconstruct.ZComponent)
back_plate_length = Number(addition)
# notes: Get the central bottom point
back_plate_width = Number(addition_2)
# notes: HOW to set automatic ad responsive plaement of the phone
# notes: Adjust the phone placement on the stand (height from origin + for/backward positions)
number_slider_3 = Slider(22.27, range=0..100)
# notes: Rotate the back plate based on the plane originated from the central bottom point
rotate = Rotate(Geometry=xy_plane, Angle=degrees(back_plate_angle), Plane=yz_plane)  # -> Geometry, Transform
vector_2pt = Vector2Pt(PointA=area.Centroid, PointB=construct_point_2, Unitize=False)  # -> Vector, Length
division = Division(A=back_plate_width, B="2")
# notes: This is the model of the cell phone.
# notes: Adjust the parameters until this model represents the phone you are designing for.
construct_point_3 = ConstructPoint(XCoordinate=0, YCoordinate=number_slider_3, ZCoordinate=Slider(42.11, range=0..100))
construct_domain = ConstructDomain(DomainStart=division, DomainEnd=expr("-x", division))
# notes: Move the cat supports
move = Move(Geometry=cat_surfaces, Motion=vector_2pt.Vector)  # -> Geometry, Transform
deconstruct_plane = DeconstructPlane(Plane=rotate.Geometry)  # -> Origin, XAxis, YAxis, ZAxis
# notes: This is a tolerance for the output.  This is related to the fabrication technique, a tolerance of 1 mm should be plenty.  If the fit is too loose, reduce this to 0.5mm.
phone_thickness = Slider(13, range=0..300)
phone_corner_radius_mm = Slider(5, range=0..300)
# notes: These parameters relate to how the phone will be used while in this stand.
phone_viewing_angle = Slider(61.74, range=0..360)
portrait_landscape = ValueList({"portrait 0": "0", "landscape 90": "90", "portrait 180": "180", "landscape 270": "270"}, selected="portrait 0")
# notes: These parameters relate to the dimensions of the phone
# [with the case on, if applicable].
phone_table_offset = Slider(20, range=0..300)
phone_tolerance_mm = Slider(1, range=0..2)
num_screen_inset = Slider(3, range=3..100)
num_projection_offset = Slider(90, range=0..200)
# notes: These parameters relate to the dimensions of the phone screen and viewing range. A void is created representing the viewing frustum.
phone_screen_offset_from_edge_mm = Slider(4, range=0..300)
num_projection_distance = Slider(200, range=0..200)
quarter_inch_to_mm = Panel("6.35")
brep_edges = BrepEdges(Brep=move.Geometry)  # -> Naked, Interior, NonManifold
pln_cell_phone_stand_design_origin = Plane(construct_point_3)
amplitude = Amplitude(Vector=deconstruct_plane.ZAxis, Amplitude=quarter_inch_to_mm)
num_phone_corner_radius = Number(phone_corner_radius_mm)
num_phone_thickness = Number(phone_thickness)
num_phone_width = Number(phone_width_mm)
num_phone_length = Number(phone_length_mm)
num_phone_viewing_angle = Number(phone_viewing_angle)
num_phone_viewing_orientation = Number(portrait_landscape)
num_phone_table_offset = Number(phone_table_offset)
num_phone_fit_tolerance = Number(phone_tolerance_mm)
num_screen_inset_2 = Number(num_screen_inset)
num_screen_offset_from_edge = Number(phone_screen_offset_from_edge_mm)
num_projection_distance_2 = Number(num_projection_distance)
num_projection_offset_2 = Number(num_projection_offset)
# notes: Adjust the back plate corner radius
back_plate_radius = Slider(15, range=0..30)
join_curves = JoinCurves(Curves=brep_edges.Naked, Preserve=False)
# notes: Move back plate shape
move_2 = Move(Geometry=rotate.Geometry, Motion=expr("-x", amplitude))  # -> Geometry, Transform
# notes: WHY the multidimensional slider works but the point constructor does not
number_slider_4 = Slider(0.11, range=0..1)
# notes: Cat shapes into grouped curves
list_item = ListItem(List=join_curves, Index=1, Wrap=True)
# notes: Back plate rectangular shape
rectangle = Rectangle(Plane=move_2.Geometry, XSize=construct_domain, YSize=back_plate_length, Radius=back_plate_radius)  # -> Rectangle, Length
# notes: Back plate rectangular shape at a distance
rectangle_2 = Rectangle(Plane=rotate.Geometry, XSize=construct_domain, YSize=back_plate_length, Radius=back_plate_radius)  # -> Rectangle, Length
cluster_cell_phone = ClusterCellPhone(
    pln_phone_location_on_table=pln_cell_phone_stand_design_origin,
    num_phone_viewing_angle=num_phone_viewing_angle,
    num_phone_viewing_orientation=num_phone_viewing_orientation,
    num_phone_table_offset=num_phone_table_offset,
    num_phone_width=num_phone_width,
    num_phone_length=num_phone_length,
    num_phone_corner_radius=num_phone_corner_radius,
    num_phone_thickness=num_phone_thickness,
    num_phone_fit_tolerance=num_phone_fit_tolerance,
    num_screen_offset_from_edge=num_screen_offset_from_edge,
    num_screen_projection_inset=num_screen_inset_2,
    num_projection_distance=num_projection_distance_2,
    num_projection_offset=num_projection_offset_2)  # -> pln_phone_origin_8, srf_phone_outline_surface_5, brep_phone_4, pln_phone_location_on_table_7, pln_phone_location_above_table_3, num_phone_volume_2, pt_phone_centroid_2, line_phone_center_of_gravity_2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
md_slider = MDSlider(
    SliderMode=0,
    slider_value=Point(0.5040402296, 0.1116310678, 0.5),
    x_domain=Domain(0, 1),
    y_domain=Domain(0, 1),
    z_domain=Domain(0, 1))
number = Number("0")
number_2 = Number("0")
# notes: Black plate curve into surface
boundary_surfaces = BoundarySurfaces(Edges=rectangle.Rectangle)  # -> reparameterize(Surfaces)
# notes: Black plate curve into surface at a distance
boundary_surfaces_2 = BoundarySurfaces(Edges=rectangle_2.Rectangle)  # -> reparameterize(Surfaces)
construct_point_4 = ConstructPoint(XCoordinate=number, YCoordinate=number_slider_4, ZCoordinate=number_2)
point = Point(md_slider)
# notes: Draw a cat head shape curve
curve = Curve(<curve referenced from the Rhino model>)
# notes: Cat-shaped cable management hole projected onto the back plate surface
evaluate_surface = EvaluateSurface(Surface=boundary_surfaces_2, Point=point)  # -> Point, Normal, UDirection, VDirection, Frame
# notes: Find intersections points of the back plate surface and the cat supports surfaces
surface_curve = SurfaceCurve(Surface=boundary_surfaces, Curve=list_item)  # -> Curves, Points, UVPoints, Normals, Parameters, Tangents
# notes: To make the phone visible, set the toggle to "true".
display_phone = BooleanToggle(False)
brep_phone = Brep(cluster_cell_phone.brep_phone_4)
brep_phone_lens = Brep(cluster_cell_phone.brep_phone_lens_4)
crv_phone_screen = Curve(cluster_cell_phone.crv_phone_screen_4)
display_phone_center_of_gravity_axis = BooleanToggle(False)
display_phone_field_of_view_cone = BooleanToggle(False)
display_phone_void = BooleanToggle(False)
pt_phone_centroid = Point(cluster_cell_phone.pt_phone_centroid_2)
line_phone_center_of_gravity = Curve(cluster_cell_phone.line_phone_center_of_gravity_2)
brep_phone_field_of_view_cone = Brep(cluster_cell_phone.brep_phone_field_of_view_cone_4)
# notes: This output is a volume representing the void for the phone and view. This will be removed from the output of the stand design.
brep_phone_void = Brep(cluster_cell_phone.brep_phone_void_2)
# notes: Adjust the siez of the cat-shaped hole for charging cable
scale = Scale(Geometry=curve, Center=Point(0, 0, 0), Factor=Slider(6.5, range=0..20))  # -> Geometry, Transform
deconstruct_2 = Deconstruct(Point=surface_curve.Points)  # -> XComponent, YComponent, ZComponent
orient = Orient(Geometry=scale.Geometry, Source=PlaneXY(0, 0, 0), Target=evaluate_surface.Frame)  # -> Geometry, Transform
filter = StreamFilter(Gate=display_phone, Stream1=brep_phone)
filter_2 = StreamFilter(Gate=display_phone, Stream1=brep_phone_lens)
filter_3 = StreamFilter(Gate=display_phone, Stream1=crv_phone_screen)
filter_4 = StreamFilter(Gate=display_phone_center_of_gravity_axis, Stream1=line_phone_center_of_gravity)
filter_5 = StreamFilter(Gate=display_phone_field_of_view_cone, Stream1=brep_phone_field_of_view_cone)
filter_6 = StreamFilter(Gate=display_phone_void, Stream1=brep_phone_void)
sort_list = SortList(Keys=deconstruct_2.ZComponent, ValuesValuesA=surface_curve.Points)  # -> Keys, ValuesValuesA
reverse_list = ReverseList(List=sort_list.ValuesValuesA)
# notes: Create the back plate surface with the cat-shaped cable hole
boundary_surfaces_3 = BoundarySurfaces(Edges=[rectangle_2.Rectangle, orient.Geometry])  # -> reparameterize(Surfaces)
list_item_2 = ListItem(List=reverse_list, Index=0, Wrap=True)
preview = CustomPreview(Geometry=filter, Material=ColourSwatch(SwatchColor=RGB(145, 145, 145)))
preview_2 = CustomPreview(Geometry=filter_2, Material=ColourSwatch(SwatchColor=RGB(84, 84, 84)))
preview_3 = CustomPreview(Geometry=filter_3, Material=ColourSwatch(SwatchColor=RGB(99, 48, 48)))
preview_4 = CustomPreview(Geometry=filter_4, Material=ColourSwatch(SwatchColor=RGB(255, 0, 0)))
preview_5 = CustomPreview(Geometry=filter_5, Material=ColourSwatch(SwatchColor=RGBA(72, 184, 178, 186)))
preview_6 = CustomPreview(Geometry=filter_6, Material=ColourSwatch(SwatchColor=RGBA(184, 72, 72, 186)))
# notes: Find the two higher intersection points and construct planes
surface_closest_point = SurfaceClosestPoint(Point=list_item_2, Surface=boundary_surfaces)  # -> Point, UVPoint, Distance
# notes: Adjust the size of the double circular inserts
number_slider_5 = Slider(16, range=0..100)
evaluate_surface_2 = EvaluateSurface(Surface=boundary_surfaces, Point=surface_closest_point.UVPoint)  # -> Point, Normal, UDirection, VDirection, Frame
# notes: Find intersections points of the back plate surface and the cat supports surfaces
surface_curve_2 = SurfaceCurve(Surface=boundary_surfaces_3, Curve=list_item)  # -> Curves, Points, UVPoints, Normals, Parameters, Tangents
circle = Circle(Plane=evaluate_surface_2.Frame, Radius=number_slider_5)
deconstruct_3 = Deconstruct(Point=surface_curve_2.Points)  # -> XComponent, YComponent, ZComponent
list_item_3 = ListItem(List=flatten(circle), Index=0, Wrap=True)  # -> Item, Item1
sort_list_2 = SortList(Keys=deconstruct_3.ZComponent, ValuesValuesA=surface_curve_2.Points)  # -> Keys, ValuesValuesA
# notes: Connet the two circular insert parts
tangent_lines_ex = TangentLinesEx(CircleA=list_item_3.Item, CircleB=list_item_3.Item1)  # -> Tangent1, Tangent2
reverse_list_2 = ReverseList(List=sort_list_2.ValuesValuesA)
curve_middle = CurveMiddle(Curve=tangent_lines_ex.Tangent2)
# notes: Get the 2 middle points of the curves connecting the circular inserts
curve_middle_2 = CurveMiddle(Curve=tangent_lines_ex.Tangent1)
list_item_4 = ListItem(List=reverse_list_2, Index=0, Wrap=True)
# notes: Find the two higher intersection points and construct planes
surface_closest_point_2 = SurfaceClosestPoint(Point=list_item_4, Surface=boundary_surfaces_3)  # -> Point, UVPoint, Distance
line = Line(StartPoint=curve_middle_2, EndPoint=curve_middle)
curve_middle_3 = CurveMiddle(Curve=line)
evaluate_surface_3 = EvaluateSurface(Surface=boundary_surfaces_3, Point=surface_closest_point_2.UVPoint)  # -> Point, Normal, UDirection, VDirection, Frame
# notes: Adjust size of curves connecting the double circular inserts (let's just do GOLDEN RATIO)
number_slider_6 = Slider(0.618, range=0..1)
vector_2pt_2 = Vector2Pt(PointA=curve_middle, PointB=curve_middle_3, Unitize=False)  # -> Vector, Length
# notes: Get the 4 end points of the curves connecting the circular inserts
vector_2pt_3 = Vector2Pt(PointA=curve_middle_2, PointB=curve_middle_3, Unitize=False)  # -> Vector, Length
multiplication = Multiplication(A=vector_2pt_3.Vector, B=number_slider_6)
multiplication_2 = Multiplication(A=vector_2pt_2.Vector, B=number_slider_6)
end_points = EndPoints(Curve=tangent_lines_ex.Tangent2)  # -> Start, End
end_points_2 = EndPoints(Curve=tangent_lines_ex.Tangent1)  # -> Start, End
move_3 = Move(Geometry=curve_middle_2, Motion=multiplication)  # -> Geometry, Transform
move_4 = Move(Geometry=curve_middle, Motion=multiplication_2)  # -> Geometry, Transform
surface = Surface(move.Geometry)
merge = Merge(Data1=end_points_2.Start, Data2=move_3.Geometry, Data3=end_points_2.End)
merge_2 = Merge(Data1=end_points.Start, Data2=move_4.Geometry, Data3=end_points.End)
nurbs_curve = NurbsCurve(Vertices=merge, Degree=2, Periodic=False)  # -> Curve, Length, Domain
nurbs_curve_2 = NurbsCurve(Vertices=merge_2, Degree=2, Periodic=False)  # -> Curve, Length, Domain
# notes: Construct curves connecting the 2 circular inserts
ruled_surface = RuledSurface(CurveA=nurbs_curve.Curve, CurveB=nurbs_curve_2.Curve)
quarter_inch_to_mm_2 = Panel("6.35")
curve_2 = Curve(ruled_surface)
division_2 = Division(A=quarter_inch_to_mm_2, B="2")
region_union = RegionUnion(Curves=flatten([curve_2, circle]))
# notes: Add to the length of the rectangular hollow cut (extend downward); reconnect if needed
number_slider_7 = Slider(42, range=0..100)
# notes: Add to the length of the rectangular hollow cut (extend upward)
number_slider_8 = Slider(36, range=0..100)
boundary_surfaces_4 = BoundarySurfaces(Edges=region_union)
# notes: Turn inserts curves into surfaces
construct_domain_2 = ConstructDomain(DomainStart=expr("-x", division_2), DomainEnd=division_2)
negative_2 = Negative(Value=number_slider_7)
# notes: Add thickness to cat supports
offset_surface = OffsetSurface(Surface=surface, Distance=division_2, BothSides=expr("-x", division_2), CreateSolid=True)
brep_edges_2 = BrepEdges(Brep=boundary_surfaces_3)  # -> Naked, Interior, NonManifold
rectangle_3 = Rectangle(Plane=evaluate_surface_3.Frame, XSize=construct_domain_2, YSize=number_slider_8, Radius=0)  # -> flatten(Rectangle), Length
join_curves_2 = JoinCurves(Curves=brep_edges_2.Naked, Preserve=False)
boundary_surfaces_5 = BoundarySurfaces(Edges=[rectangle_3.Rectangle, join_curves_2])
trim_solid = TrimSolid(Shape=boundary_surfaces_4, Cutters=flatten(offset_surface))
# notes: WHY the extended rectangular hollow spaces are not fully cut through
trim_solid_2 = TrimSolid(Shape=boundary_surfaces_5, Cutters=flatten(offset_surface))
cluster = Cluster_3(relay=surface)
# notes: Add thickness to the back plate with trimmed holes
quarter_inch_to_mm_3 = Panel("6.35")
quarter_inch_to_mm_4 = Panel("6.35")
cluster_2 = Cluster_3(relay=trim_solid)
# notes: Add thickness to the 2 trimmed inserts
offset_surface_2 = OffsetSurface(Surface=trim_solid, Distance=1, BothSides=expr("-x", quarter_inch_to_mm_4), CreateSolid=True)
offset_surface_3 = OffsetSurface(Surface=trim_solid_2, Distance=quarter_inch_to_mm_3, BothSides=expr("-x", 0), CreateSolid=True)
cluster_3 = Cluster_3(relay=trim_solid_2)
merge_3 = Merge(Data1=cluster, Data2=cluster_2, Data3=cluster_3)  # -> flatten(Result)
merge_4 = Merge(Data1=surface, Data2=trim_solid, Data3=trim_solid_2)  # -> flatten(Result)
construct_point_5 = ConstructPoint(XCoordinate=0, YCoordinate=0, ZCoordinate=0)
spread_final_2d_shapes = Slider(1385, range=0..1500)
list_length = ListLength(List=merge_4)
preview_7 = CustomPreview(Geometry=[offset_surface, offset_surface_2, offset_surface_3], Material=ColourSwatch(SwatchColor=RGB(255, 230, 212)))
unit_x = UnitX(Factor=1)
# notes: Layout for 2D laser cut
line_sdl = LineSDL(Start=construct_point_5, Direction=unit_x, Length=spread_final_2d_shapes)
divide_curve = DivideCurve(Curve=line_sdl, Count=list_length, Kinks=False)  # -> Points, Tangents, Parameters
cull_index = CullIndex(List=divide_curve.Points, Indices=0, Wrap=True)
orient_bake_this = Orient(Geometry=merge_4, Source=merge_3, Target=cull_index)  # -> Geometry, Transform

# ==== cluster ClusterCellPhone
num_phone_viewing_angle = ClusterInput()
num_phone_viewing_orientation = ClusterInput()
num_phone_table_offset = ClusterInput()
pln_phone_location_on_table = ClusterInput()
num_phone_width = ClusterInput()
num_phone_length = ClusterInput()
num_phone_corner_radius = ClusterInput()
num_phone_thickness = ClusterInput()
num_phone_fit_tolerance = ClusterInput()
num_screen_offset_from_edge = ClusterInput()
num_screen_projection_inset = ClusterInput()
num_projection_distance = ClusterInput()
num_projection_offset = ClusterInput()
num_phone_viewing_angle_2 = Number(num_phone_viewing_angle)
num_phone_table_offset_2 = Number(num_phone_table_offset)
num_phone_viewing_orientation_2 = Number(num_phone_viewing_orientation)
# notes: let us construct an origin point for the cell phone.
notes = Panel("phone body")
phone_location_x_coordinate = Slider(0, range=0..300)
phone_location_y_coordinate = Slider(0, range=0..300)
phone_location_z_coordinate = Slider(0, range=0..300)
num_projection_distance_2 = Number(num_projection_distance)
num_projection_offset_2 = Number(num_projection_offset)
num_screen_projection_inset_2 = Number(num_screen_projection_inset)
# notes: let us define the screen as an offset from the outside edge of the device
notes_2 = Panel("phone screen")
num_phone_thickness_2 = Number(num_phone_thickness)
num_phone_corner_radius_2 = Number(num_phone_corner_radius)
num_phone_width_2 = Number(num_phone_width)
num_phone_length_2 = Number(num_phone_length)
num_phone_fit_tolerance_2 = Number(num_phone_fit_tolerance)
camera35mmlenslength = Slider(24, range=18..80)
# notes: let us construct an origin point for the cell phone camera relative to the origin point of the phone.
notes_3 = Panel("phone camera lens")
# notes: let us construct a representation of the field of view for the camera.
phone_lens_view_depth = Slider(3000, range=0..3000)
phone_lens_location_x_coordinate = Slider(0, range=0..300)
phone_lens_location_y_coordinate = Slider(150, range=0..300)
phone_lens_location_z_coordinate = Slider(13, range=0..300)
phone_lens_rim_offset = Slider(3, range=0..300)
phone_lens_radius = Slider(5, range=0..25)
# notes: phone camera view frustum
phone_lens_thickness = Slider(0.5, range=0..2)
pln_phone_location_on_table_2 = Plane(pln_phone_location_on_table)
# notes: This is a point that will help us conceptually connect the virtual world to the physical world.
pt_phone_origin = ConstructPoint(
    XCoordinate=phone_location_x_coordinate,
    YCoordinate=phone_location_y_coordinate,
    ZCoordinate=phone_location_z_coordinate)
num_camera35mmlenslength = Number(camera35mmlenslength)
num_screen_offset_from_edge_2 = Number(num_screen_offset_from_edge)
vec_lens_location = VectorXYZ(
    XComponent=phone_lens_location_x_coordinate,
    YComponent=phone_lens_location_y_coordinate,
    ZComponent=phone_lens_location_z_coordinate)  # -> Vector, Length
# notes: right click on the grey box allows me to name this element.
pt_phone_origin_2 = Point(pt_phone_origin)
cluster = Cluster(num_camera35mmlenslength=num_camera35mmlenslength)
division = Division(A=num_phone_width_2, B="2.0")
# notes: a reference plane whose origin is that point
xy = XYPlane(Origin=pt_phone_origin_2)
neg = Negative(Value=division)
panel = Panel(division)
neg_2 = Negative(Value=num_screen_offset_from_edge_2)
num_fov = Number(cluster)
dom = ConstructDomain(DomainStart=division, DomainEnd=neg)
pln_phone_origin = Plane(xy)
pln_phone_origin_2 = Plane(pln_phone_origin)
move = Move(Geometry=pln_phone_origin_2, Motion=vec_lens_location.Vector)  # -> Geometry, Transform
pln_phone_lens_origin = Plane(move.Geometry)
cir = Circle(Plane=pln_phone_lens_origin, Radius=phone_lens_radius)
crv_phone_lens_outline = Curve(cir)
pln_phone_lens_origin_2 = Plane(pln_phone_lens_origin)
neg_3 = Negative(Value=phone_lens_rim_offset)
panel_2 = Panel(dom)
Z = UnitZ(Factor=phone_lens_view_depth)
# notes: here we create a fustrum that more accurately reflects the camera view and what is seen on screen.
pln_phone_lens_origin_3 = Plane(pln_phone_lens_origin)
multiplication = Multiplication(A="9", B=num_fov)
# notes: with this we can set up a view to see what the camera will see while in the stand.  we can also test whether specific object will be in the field of view.
multiplication_2 = Multiplication(A="16", B=num_fov)
offset = OffsetCurve(Curve=crv_phone_lens_outline, Distance=neg_3, Corners=1)
multiplication_3 = Multiplication(A=phone_lens_view_depth, B=multiplication)
multiplication_4 = Multiplication(A=phone_lens_view_depth, B=multiplication_2)
merge = Merge(Data1=crv_phone_lens_outline, Data2=offset)  # -> flatten(Result)
panel_3 = Panel(pln_phone_lens_origin_2)
move_2 = Move(Geometry=pln_phone_lens_origin_3, Motion=Z)  # -> Geometry, Transform
num_x_size = Number(multiplication_3)
num_y_size = Number(multiplication_4)
boundary = BoundarySurfaces(Edges=merge)
# notes: this creates a rectangle from the input of a plane, X dimension, and Y dimension.
phone_rectangle = Rectangle(Plane=pln_phone_origin, XSize=dom, YSize=num_phone_length_2, Radius=num_phone_corner_radius_2)  # -> Rectangle, Length
pln_phone_lens_origin_4 = Plane(move_2.Geometry)
num_phone_fit_tolerance_3 = Number(num_phone_fit_tolerance_2)
srf_phone_lens_outline_surface = Surface(boundary)
division_2 = Division(A=num_x_size, B="2.0")
division_3 = Division(A=num_y_size, B="2.0")
num_phone_thickness_3 = Number(num_phone_thickness_2)
rectangle_length = Panel(phone_rectangle.Length)
neg_4 = Negative(Value=division_2)
neg_5 = Negative(Value=division_3)
Z_2 = UnitZ(Factor=phone_lens_thickness)
crv_phone_outline = Curve(phone_rectangle.Rectangle)
crv_phone_outline_2 = Curve(crv_phone_outline)
offset_2 = OffsetCurve(Curve=crv_phone_outline_2, Distance=neg_2, Corners=1)
panel_4 = Panel(offset_2)
crv = Curve(flatten(offset_2))
crv_phone_outline_3 = Curve(crv_phone_outline)
dom_2 = ConstructDomain(DomainStart=division_2, DomainEnd=neg_4)
dom_3 = ConstructDomain(DomainStart=division_3, DomainEnd=neg_5)
num_x_2_0 = Number(expr("x*2.0", num_phone_fit_tolerance_3))
offset_3 = OffsetCurve(Curve=crv_phone_outline_3, Distance=num_phone_fit_tolerance_3, Corners=1)  # -> flatten(Curve)
Z_3 = UnitZ(Factor=num_phone_fit_tolerance_3)
extr = Extrude(Base=srf_phone_lens_outline_surface, Direction=Z_2)
boundary_2 = BoundarySurfaces(Edges=offset_3)
pln_phone_lens_origin_5 = Plane(pln_phone_lens_origin_2)
brep_phone_lens = Brep(extr)
addition = Addition(A=num_phone_thickness_3, B=num_x_2_0)
rectangle = Rectangle(Plane=pln_phone_lens_origin_4, XSize=dom_2, YSize=dom_3, Radius=0)  # -> Rectangle, Length
srf_tolerance_phone_outline_surface = Surface(boundary_2)
rev = Reverse(Vector=Z_3)
extr_2 = ExtrudePoint(Base=rectangle.Rectangle, Point=pln_phone_lens_origin_3)
# notes: this creates a surface from the curve.  the input curve becomes the surface edge.
boundary_3 = BoundarySurfaces(Edges=crv_phone_outline)
Z_4 = UnitZ(Factor=addition)
cap = CapHoles(Brep=extr_2)
srf_phone_outline_surface = Surface(boundary_3)
brep_phone_field_of_view_cone = Brep(cap)
move_3 = Move(Geometry=srf_tolerance_phone_outline_surface, Motion=rev)  # -> Geometry, Transform
Z_5 = UnitZ(Factor=num_phone_thickness_3)
extr_3 = Extrude(Base=move_3.Geometry, Direction=Z_4)
extr_4 = Extrude(Base=srf_phone_outline_surface, Direction=Z_5)
vec = Vector(Z_5)
move_4 = Move(Geometry=crv, Motion=vec)  # -> Geometry, Transform
crv_phone_screen = Curve(move_4.Geometry)
num_screen_projection_inset_3 = Number(num_screen_projection_inset_2)
num_projection_distance_3 = Number(num_projection_distance_2)
num_projection_offset_3 = Number(num_projection_offset_2)
cluster_2 = Cluster_2(
    crv_phone_screen=crv_phone_screen,
    num_screen_inset=num_screen_projection_inset_3,
    num_projection_distance=num_projection_distance_3,
    num_projection_offset=num_projection_offset_3)
brep_phone = Brep(extr_4)
brep_phone_field_of_view_cone_2 = Brep(brep_phone_field_of_view_cone)
brep_screen_viewing_volume = Brep(cluster_2)
srf_phone_outline_surface_2 = Surface(boundary_3)
brep_tolerance_phone = Brep(extr_3)
pln_phone_lens_origin_6 = Plane(pln_phone_lens_origin_5)
crv_phone_outline_4 = Curve(phone_rectangle.Rectangle)
crv_phone_screen_2 = Curve(move_4.Geometry)
pln_phone_origin_3 = Plane(xy)
brep_phone_lens_2 = Brep(brep_phone_lens)
brep_phone_2 = Brep(brep_phone)
pln_phone_location_on_table_3 = Plane(pln_phone_location_on_table_2)
merge_phone_components = Merge(
    Data1=pln_phone_origin_3,
    Data2=crv_phone_outline_4,
    Data3=srf_phone_outline_surface_2,
    Data4=brep_phone_2,
    Data5=brep_phone_lens_2,
    Data6=pln_phone_lens_origin_6,
    Data7=brep_phone_field_of_view_cone_2,
    Data8=crv_phone_screen_2,
    Data9=brep_tolerance_phone,
    Data10=brep_screen_viewing_volume)
num_phone_table_offset_3 = Number(num_phone_table_offset_2)
pln_phone_location_on_table_4 = Plane(pln_phone_location_on_table_3)

# ----
# notes: adjust phone location relative to table
phone_table_offset = Slider(16, range=-50..50)
num_phone_table_offset_4 = Number(num_phone_table_offset_3)
num_phone_table_offset_5 = Number(num_phone_table_offset_4)
Z_6 = UnitZ(Factor=num_phone_table_offset_5)
move_5 = Move(Geometry=pln_phone_location_on_table_4, Motion=Z_6)  # -> Geometry, Transform

pln_phone_location_above_table = Plane(move_5.Geometry)
pln_phone_location_on_table_5 = Plane(pln_phone_location_on_table_4)
vec2pt = Vector2Pt(PointA=pln_phone_location_on_table_5, PointB=pln_phone_location_above_table, Unitize=False)  # -> Vector, Length
vdis = VectorDisplay(Anchor=pln_phone_location_on_table_5, Vector=vec2pt.Vector)
num_phone_viewing_angle_3 = Number(num_phone_viewing_angle_2)
pln_phone_location_on_table_6 = Plane(pln_phone_location_on_table_2)
pln_phone_location_above_table_2 = Plane(pln_phone_location_above_table)
pln_phone_location_above_table_3 = ClusterOutput(pln_phone_location_above_table_2)
pln_phone_location_on_table_7 = ClusterOutput(pln_phone_location_on_table_6)

# ----
# notes: set the viewing orientation, "portrait/landscape"
geo_phone_components = Geometry(merge_phone_components)
portrait_landscape = ValueList({"portrait 0": "0", "landscape 90": "90", "portrait 180": "180", "landscape 270": "270"}, selected="landscape 90")
num_phone_viewing_orientation_3 = Number(num_phone_viewing_orientation_2)
item = ListItem(List=geo_phone_components, Index="0", Wrap=True)
item_2 = ListItem(List=geo_phone_components, Index="2", Wrap=True)
srf_phone_outline_surface_3 = Surface(item_2)
pln_phone_origin_4 = Plane(item)
area = Area(Geometry=srf_phone_outline_surface_3)  # -> Area, Centroid
pl_origin = PlaneOrigin(Base=pln_phone_origin_4, Origin=area.Centroid)

num_phone_viewing_orientation_4 = Number(num_phone_viewing_orientation_3)

rotate = Rotate(Geometry=geo_phone_components, Angle=degrees(num_phone_viewing_orientation_4), Plane=pl_origin)  # -> Geometry, Transform
geo_phone_components_2 = Geometry(rotate.Geometry)

# ----
# notes: move phone location based on orientation
pln_phone_location_above_table_4 = Plane(pln_phone_location_above_table)
geo_phone_components_3 = Geometry(geo_phone_components_2)
item_3 = ListItem(List=geo_phone_components_3, Index="0", Wrap=True)
pln_phone_origin_5 = Plane(item_3)
vec2pt_2 = Vector2Pt(PointA=pln_phone_origin_5, PointB=pln_phone_location_above_table_4, Unitize=False)  # -> Vector, Length
geo_phone_components_4 = Geometry(geo_phone_components_3)
item_4 = ListItem(List=geo_phone_components_4, Index="1", Wrap=True)
crv_phone_outline_5 = Curve(item_4)
crv_cp = CurveClosestPoint(Point=pln_phone_location_above_table_4, Curve=crv_phone_outline_5)  # -> Point, Parameter, Distance
vec2pt_3 = Vector2Pt(PointA=crv_cp.Point, PointB=pln_phone_location_above_table_4, Unitize=False)  # -> Vector, Length
move_6 = Move(Geometry=geo_phone_components_4, Motion=vec2pt_3.Vector)  # -> Geometry, Transform
vdis_2 = VectorDisplay(Anchor=crv_cp.Point, Vector=vec2pt_3.Vector)
geo_phone_components_5 = Geometry(move_6.Geometry)

# ----
# notes: rotate the phone to viewing position
geo_phone_components_6 = Geometry(geo_phone_components_5)
num_zero = Number(0)
item_5 = ListItem(List=geo_phone_components_6, Index="0", Wrap=True)
num_phone_viewing_direction = Number(num_zero)
pln_phone_origin_6 = Plane(item_5)
rotate_2 = Rotate(Geometry=geo_phone_components_6, Angle=degrees(num_phone_viewing_direction), Plane=pln_phone_origin_6)  # -> Geometry, Transform
geo_phone_components_7 = Geometry(rotate_2.Geometry)

pln_phone_location_above_table_5 = Plane(pln_phone_location_above_table_4)

# ----
# notes: rotate the phone to viewing position "up/down"
geo_phone_components_8 = Geometry(geo_phone_components_7)
phone_viewing_angle = Slider(72, range=0..360)
deplane = DeconstructPlane(Plane=pln_phone_location_above_table_5)  # -> Origin, XAxis, YAxis, ZAxis
num_phone_viewing_angle_4 = Number(num_phone_viewing_angle_3)
line = LineSDL(Start=deplane.Origin, Direction=deplane.XAxis, Length=1)
rotax = RotateAxis(Geometry=geo_phone_components_8, Angle=degrees(num_phone_viewing_angle_4), Axis=line)  # -> Geometry, Transform
geo_phone_components_9 = Geometry(rotax.Geometry)

geo_phone_components_10 = Geometry(geo_phone_components_9)
geo_phone_components_11 = Geometry(geo_phone_components_10)
geo_phone_components_12 = Geometry(geo_phone_components_11)
item_6 = ListItem(List=geo_phone_components_12, Index="0", Wrap=True)
item_7 = ListItem(List=geo_phone_components_12, Index="2", Wrap=True)
item_8 = ListItem(List=geo_phone_components_12, Index="3", Wrap=True)
item_9 = ListItem(List=geo_phone_components_12, Index="4", Wrap=True)
item_10 = ListItem(List=geo_phone_components_12, Index="6", Wrap=True)
item_11 = ListItem(List=geo_phone_components_12, Index="7", Wrap=True)
item_12 = ListItem(List=geo_phone_components_12, Index="8", Wrap=True)
item_13 = ListItem(List=geo_phone_components_12, Index="9", Wrap=True)
srf_phone_outline_surface_4 = Surface(item_7)
brep_phone_3 = Brep(item_8)
brep_phone_lens_3 = Brep(item_9)
pln_phone_origin_7 = Plane(item_6)
crv_phone_screen_3 = Curve(item_11)
brep_tolerance_phone_2 = Brep(item_12)
brep_screen_viewing_volume_2 = Brep(item_13)
brep_phone_field_of_view_cone_3 = Brep(item_10)
merge_2 = Merge(Data1=brep_tolerance_phone_2, Data2=brep_screen_viewing_volume_2)
volume = Volume(Geometry=brep_phone_3)  # -> Volume, Centroid
pt_phone_centroid = Point(volume.Centroid)
num_phone_volume = Number(volume.Volume)
sunion = SolidUnion(Breps=merge_2)
fmerge = MergeFaces(Brep=sunion)  # -> Breps, Before, After
project = Project(Geometry=pt_phone_centroid, Plane=pln_phone_location_on_table_6)  # -> Geometry, Transform
brep_phone_void = Brep(fmerge.Breps)
ln = Line(StartPoint=pt_phone_centroid, EndPoint=project.Geometry)
line_phone_center_of_gravity = Line(ln)
line_phone_center_of_gravity_2 = ClusterOutput(line_phone_center_of_gravity)
pln_phone_origin_8 = ClusterOutput(pln_phone_origin_7)
srf_phone_outline_surface_5 = ClusterOutput(srf_phone_outline_surface_4)
brep_phone_4 = ClusterOutput(brep_phone_3)
num_phone_volume_2 = ClusterOutput(num_phone_volume)
pt_phone_centroid_2 = ClusterOutput(pt_phone_centroid)
brep_phone_lens_4 = ClusterOutput(brep_phone_lens_3)
crv_phone_screen_4 = ClusterOutput(crv_phone_screen_3)
brep_tolerance_phone_3 = ClusterOutput(brep_tolerance_phone_2)
brep_screen_viewing_volume_3 = ClusterOutput(brep_screen_viewing_volume_2)
brep_phone_field_of_view_cone_4 = ClusterOutput(brep_phone_field_of_view_cone_3)
brep_phone_void_2 = ClusterOutput(brep_phone_void)

# ==== cluster Cluster_3
relay = ClusterInput()
area = Area(Geometry=relay)  # -> Area, Centroid
surface_closest_point = SurfaceClosestPoint(Point=area.Centroid, Surface=relay)  # -> Point, UVPoint, Distance
evaluate_surface = EvaluateSurface(Surface=relay, Point=surface_closest_point.UVPoint)  # -> Point, Normal, UDirection, VDirection, Frame
frame = ClusterOutput(evaluate_surface.Frame)

# ==== cluster Cluster
num_camera35mmlenslength = ClusterInput()
# notes: these values were determined empirically. this equation may require adjestment depending on your setup.
num_camera35mmlenslength_2 = Number(num_camera35mmlenslength)
num = Number("2/30")
num_2 = Number("40")
multiplication = Multiplication(A=num_2, B=num)
division = Division(A=multiplication, B=num_camera35mmlenslength_2)
panel = Panel(division)
panel_2 = Panel(multiplication)
num_fov = Number(division)
num_fov_2 = ClusterOutput(num_fov)

# ==== cluster Cluster_2
num_projection_distance = ClusterInput()
num_projection_offset = ClusterInput()
crv_phone_screen = ClusterInput()
num_screen_inset = ClusterInput()
num_projection_distance_2 = Number(num_projection_distance)
num_projection_offset_2 = Number(num_projection_offset)
crv_phone_screen_2 = Curve(crv_phone_screen)
num_screen_inset_2 = Number(num_screen_inset)
offset = OffsetCurve(Curve=crv_phone_screen_2, Distance=Slider(0, range=0..10), Corners=3)  # -> flatten(Curve)
crv_phone_screen_3 = Curve(offset)
boundary = BoundarySurfaces(Edges=crv_phone_screen_3)
area = Area(Geometry=boundary)  # -> Area, Centroid
srf_cp = SurfaceClosestPoint(Point=area.Centroid, Surface=boundary)  # -> Point, UVPoint, Distance
evalsrf = EvaluateSurface(Surface=boundary, Point=srf_cp.UVPoint)  # -> Point, Normal, UDirection, VDirection, Frame
num_projection_distance_3 = Number(num_projection_distance_2)
num_projection_offset_3 = Number(num_projection_offset_2)
num_screen_inset_3 = Number(num_screen_inset_2)
vec = Vector(evalsrf.Normal)
crv_phone_screen_4 = Curve(crv_phone_screen_3)
amp = Amplitude(Vector=vec, Amplitude=num_screen_inset_3)
amp_2 = Amplitude(Vector=vec, Amplitude=num_projection_distance_3)
move = Move(Geometry=crv_phone_screen_4, Motion=amp)  # -> Geometry, Transform
move_2 = Move(Geometry=move.Geometry, Motion=amp_2)  # -> Geometry, Transform
offset_2 = OffsetCurve(Curve=move_2.Geometry, Distance=num_projection_offset_3, Corners=1)  # -> flatten(Curve)
rulesrf = RuledSurface(CurveA=crv_phone_screen_4, CurveB=move.Geometry)
rulesrf_2 = RuledSurface(CurveA=move.Geometry, CurveB=offset_2)
cap = CapHoles(Brep=rulesrf)
cap_2 = CapHoles(Brep=rulesrf_2)
merge = Merge(Data1=cap, Data2=cap_2)
sunion = SolidUnion(Breps=merge)
brep_screen_viewing_volume = Brep(sunion)
brep_screen_viewing_volume_2 = ClusterOutput(brep_screen_viewing_volume)
